# Grasshopper definition unnamed.gh (Grasshopper 1.0.8)

edge_surface = EdgeSurface(
    CurveA=<geometry referenced from the Rhino model>,
    CurveB=[<geometry referenced from the Rhino model> x3],
    CurveC=<geometry referenced from the Rhino model>)
mesh_surface = MeshSurface(
    Surface=<geometry referenced from the Rhino model>,
    UCount=Slider(4, range=0..100),
    VCount=Slider(19, range=0..100),
    Overhang=True,
    Equalize=False)
plane_origin = PlaneOrigin()
deconstruct_mesh = DeconstructMesh(Mesh=mesh_surface)  # -> Vertices, Faces, Colours, Normals
point_list = PointList(Points=deconstruct_mesh.Vertices, Size=Slider(4, range=1..50))
planar = Planar(Curve=<geometry referenced from the Rhino model>)  # -> Planar, Plane, Deviation
circle = Circle(Plane=plane_origin, Radius=1)
